vi "index.gviweb"   [LabVIEW NXG 5.0.0]
panel controls:
  "HOR": bool
  "ANTIH": bool
  "1BOB": bool
  "2BOB": bool
  "MEDIO": bool
  "DIRECCIÓN IP": string = "http://192.168.1.245:8002"
  "PARO": bool
panel indicators:
  "LED_1": bool
  "LED_2": bool
  "LED_3": bool
  "LED_4": bool
  "LED_5": bool
  "Giro motor": bool
  "Numero": f64
  "String Constant": string
  "IN1R": bool
  "IN2R": bool
  "IN3R": bool
  "IN4R": bool
  "Vmotor": f64
  "Indicador Velocidad": f64
types:
  T1 = cluster{"Numero": f64, "Giro motor": bool, "IN1R": bool, "IN2R": bool, "IN3R": bool, "IN4R": bool, "Vmotor": f64}
uses:
  NI::HTTP::Open HTTP Handle.gvi
  NI::HTTP::POST Buffer.gvi
  NI::HTTP::Close HTTP Handle.gvi
  NI::HTTP::GET.gvi
diagram:
  s1 = uninitialised  # shift register
  while (iteration -> i1) {
    $LED_1 <- $HOR
    Build Array($HOR, $ANTIH, $"1BOB", $"2BOB", $MEDIO) -> w1
    Boolean Array To Number(Boolean array=w1) -> (number=w2)
    Is Not Equal(x=w2, y=s1) -> w3
    Is Not Equal To 0(x=i1) -> w4
    Logical And(w3, w4) -> w5
    case (w5) {
      frame False, Default { }
      frame True {
        call "Open HTTP Handle.gvi"() -> (client handle out=w6, error out=w7)
        Build Cluster($HOR, $ANTIH, $"2BOB", $"1BOB", $MEDIO) -> w8
        Flatten To Json(anything=w8) -> (JSON string=w9)
        Concatenate Strings($"DIRECCIÓN IP", "/Webservice1/Escritura") -> w10
        call "POST Buffer.gvi"(client handle=w6, url=w10, buffer=w9, error in=w7) -> (client handle out=w11, error out=w12)
        call "Close HTTP Handle.gvi"(client handle=w11, error in=w12)
        $"String Constant" <- w9
      }
    }
    $LED_2 <- $ANTIH
    $LED_3 <- $"2BOB"
    $LED_4 <- $"1BOB"
    $LED_5 <- $MEDIO
    Concatenate Strings($"DIRECCIÓN IP", "/Webservice1/Lectura") -> w13
    call "GET.gvi"(timeout=10000, url=w13) -> (body=w14)
    w15 = T1 {all zero or empty}  # cluster
    Unflatten From Json(JSON string=w14, type and defaults=w15) -> (value=w16)
    Property Node(instance in=w16) -> ("Giro motor"=w17, "Numero"=w18, "IN4R"=w19, "IN1R"=w20, "IN2R"=w21, "IN3R"=w22, "Vmotor"=w23)
    $"Giro motor" <- w17
    case ($PARO) {
      frame False, Default { }
      frame True {
        $HOR <- FALSE
        $ANTIH <- FALSE
        $"1BOB" <- FALSE
        $"2BOB" <- FALSE
        $MEDIO <- FALSE
      }
    }
    $Numero <- w18
    $IN1R <- w20
    $IN2R <- w21
    $IN3R <- w22
    $IN4R <- w19
    $Vmotor <- w23
    $"Indicador Velocidad" <- w23
    Wait(time to wait=20)
    next s1 = w2
    stop if FALSE
  }
